# Dynamo graph Treliça Espacial - Dynamo.dyn (Dynamo 2.1.0.7500)

select_edge = DSEdgeSelection()  # 1 picked in the model
select_edge_2 = DSEdgeSelection()  # 1 picked in the model
list_create = List.Create(item0=select_edge, item1=select_edge_2)
byLoft = Surface.ByLoft(crossSections=list_create)
quant_eixos = DoubleSlider(10, range=0..25 step 1)
panelQuad = Geometry.Panel.PanelQuad(srf=byLoft, u=quant_eixos, v=quant_eixos)
watch = Watch(panelQuad.Panels)
byPoints = Polygon.ByPoints(points=panelQuad.Points)
center = Polygon.Center(polygon=byPoints)
altura_treliça = DoubleSlider(4, range=0..5 step 1)
translate = Geometry.Translate(geometry=panelQuad.Points, zTranslation=altura_treliça)
byStartPointEndPoint = Line.ByStartPointEndPoint(startPoint=center, endPoint=translate)
levels = Levels("Nível 1")
família_paramétrica = FamilyTypes("Barras redondas:RB300.04")
beamByCurve = StructuralFraming.BeamByCurve(curve=byStartPointEndPoint, level=levels, structuralFramingType=família_paramétrica)
translate_2 = Geometry.Translate(geometry=byPoints, zTranslation=altura_treliça)
corners = Polygon.Corners(polygon=translate_2)
splitByPoints = Curve.SplitByPoints(curve=translate_2, points=corners)
beamByCurve_2 = StructuralFraming.BeamByCurve(curve=splitByPoints, level=levels, structuralFramingType=família_paramétrica)
