# Grasshopper definition Treliça estrutural.gh (Grasshopper 1.0.7)

number_slider = Slider(10, range=0..10)

surface = Surface(<surface referenced from the Rhino model>)

divide_domain² = DivideDomain²(Domain=surface, UCount=Slider(10, range=0..10), VCount=number_slider)
isotrim = Isotrim(Surface=surface, Domain=divide_domain²)

md_slider = MDSlider(SliderMode=0, slider_value=Point(0.5, 0.5, 0.5), x_domain=Domain(0, 1), y_domain=Domain(0, 1), z_domain=Domain(0, 1))
deconstruct_brep = DeconstructBrep(Brep=isotrim)  # -> Faces, Edges, Vertices
evaluate_surface = EvaluateSurface(Surface=reparameterize(deconstruct_brep.Faces), Point=md_slider)  # -> Point, Normal, UDirection, VDirection, Frame
line_sdl = LineSDL(Start=evaluate_surface.Point, Direction=evaluate_surface.Normal, Length=Slider(1, range=0..10))
end_points = EndPoints(Curve=line_sdl)  # -> Start, End
point = Point(end_points.End)

partition_list = PartitionList(List=flatten(point), Size=number_slider)
flip_matrix = FlipMatrix(Data=partition_list)
interpolate = Interpolate(Vertices=flip_matrix, Degree=3, Periodic=False, KnotStyle=1)  # -> Curve, Length, Domain
interpolate_2 = Interpolate(Vertices=partition_list, Degree=3, Periodic=False, KnotStyle=1)  # -> Curve, Length, Domain
line = Line(StartPoint=end_points.End, EndPoint=deconstruct_brep.Vertices)
curve = Curve(deconstruct_brep.Edges)

pipe = Pipe(Curve=[interpolate_2.Curve, interpolate.Curve, line, curve], Radius=Slider(0.05, range=0..0.1), Caps=0)
