# Grasshopper definition spatial deformation.gh (Grasshopper 1.0.7)

md_slider = MDSlider(
    SliderMode=0,
    slider_value=Point(0.3009178792, 0, 0.5),
    x_domain=Domain(0, 1),
    y_domain=Domain(0, 1),
    z_domain=Domain(0, 1))
md_slider_2 = MDSlider(
    SliderMode=0,
    slider_value=Point(0.5145625305, 1, 0.5),
    x_domain=Domain(0, 1),
    y_domain=Domain(0, 1),
    z_domain=Domain(0, 1))
plane_surface = PlaneSurface(Plane=PlaneXY(0, 0, 0), XSize=Slider(51.8, range=0..100), YSize=Slider(51.8, range=0..100))
evaluate_surface = EvaluateSurface(Surface=reparameterize(plane_surface), Point=[md_slider, md_slider_2])  # -> flatten(Point), Normal, UDirection, VDirection, Frame
deconstruct_brep = DeconstructBrep(Brep=plane_surface)  # -> Faces, Edges, flatten(Vertices)
_1 = Slider(24.66, range=0..100)
_2 = Slider(16.92, range=0..100)
unit_z = UnitZ(Factor=Slider(0, range=0..100))
duplicate_data = DuplicateData(Data=unit_z, Number=Slider(4, range=0..10), Order=True)  # -> flatten(Data)
unit_z_2 = UnitZ(Factor=[_1, _2])  # -> flatten(UnitVector)
f = Slider(2, range=0..4)
text_join = TextJoin(Text=["1/x^", f])
spatial_deform_custom = SpatialDeformCustom(
    Geometry=plane_surface,
    Syntax=[evaluate_surface.Point, deconstruct_brep.Vertices],
    Forces=[unit_z_2, duplicate_data],
    Falloff=text_join)
surface = Surface(spatial_deform_custom)
